% Simulink data dictionary demo_env_bus_types.sldd

demo_env_FS_CS_Dist_ZeroNoise_LT = Simulink.Bus()
demo_env_FS1_CS_Dist_ZeroNoise_LT = Simulink.Bus()

demo_env_Controller1_Controller1_DT = Simulink.Bus()
  d1: double[2 2]
  d12: double
  log1: double

demo_env_Controller1_Controller1_PT = Simulink.Bus()
  p1: double
  p2: double
  p12: double

demo_env_Controller1_Controller1_LT = Simulink.Bus()
  log1: double

demo_env_Controller2_Controller2_DT = Simulink.Bus()
  d1: double[1 3]
  d2: double[1 3]
  d3: double[1 3]

demo_env_Controller2_Controller2_LT = Simulink.Bus()
  d3: double[1 3]