% Simulink data dictionary marine_otter_velocity_bus_types.sldd

marine_otter_velocity_FS_CS_Dist_ZeroNoise_LT = Simulink.Bus()
marine_otter_velocity_FS1_CS_Dist_ZeroNoise_LT = Simulink.Bus()
marine_otter_velocity_FS2_CS_Dist_ZeroNoise_LT = Simulink.Bus()

marine_otter_velocity_Explicit0_Explicit0_model_DT = Simulink.Bus()
  O: double[3 2]
  Cl: double[3 3]
  O_pinv: double[2 3]

marine_otter_velocity_Explicit0_Explicit0_DT = Simulink.Bus()
  m: double
  p: double
  uini: double[3 1]
  yini: double[3 1]
  eta: double
  old_y_ref: double
  model: marine_otter_velocity_Explicit0_Explicit0_model_DT

marine_otter_velocity_Explicit0_Explicit0_PT = Simulink.Bus()
  A: double[2 2]
  B: double[2 1]
  C: double[1 2]
  D: double
  Tini: double
  is_incremental: double
  use_ref_integral: double
  Ki: double
  u_min: double
  u_max: double
  base_variable_name: uint8[1 2]
  y_min: double
  y_max: double
  solution_path: uint8[1 21]

marine_otter_velocity_Explicit0_Explicit0_LT = Simulink.Bus()