% Simulink data dictionary otter_vel_bus_types.sldd

otter_vel_DeePC_DeePC_Ctl_ATDeePC_idx_uini_v_I = Simulink.Bus()
  b: double
  e: double
  sz: double
  r: double[1 3]

otter_vel_DeePC_DeePC_Ctl_ATDeePC_idx_u_v_I = Simulink.Bus()
  b: double
  e: double
  sz: double
  r: double[1 25]

otter_vel_DeePC_DeePC_Ctl_ATDeePC_idx_yini_v_I = Simulink.Bus()
  b: double
  e: double
  sz: double
  r: double[1 3]

otter_vel_DeePC_DeePC_Ctl_ATDeePC_idx_y_v_I = Simulink.Bus()
  b: double
  e: double
  sz: double
  r: double[1 25]

otter_vel_DeePC_DeePC_Ctl_ATDeePC_idx_u_I = Simulink.Bus()
  b: double
  e: double
  sz: double
  r: double[1 25]

otter_vel_DeePC_DeePC_Ctl_ATDeePC_idx_y_I = Simulink.Bus()
  b: double
  e: double
  sz: double
  r: double[1 25]

otter_vel_DeePC_DeePC_Ctl_ATDeePC_idx_yp_I = Simulink.Bus()
  b: double
  e: double
  sz: double
  r: double

otter_vel_DeePC_DeePC_Ctl_ATDeePC_idx_s_I = Simulink.Bus()
  b: double
  e: double
  sz: double
  r: double[1 28]

otter_vel_DeePC_DeePC_Ctl_ATDeePC_idx_A_v_I = Simulink.Bus()
  b: double
  e: double
  sz: double
  r: double[1 56]

otter_vel_DeePC_DeePC_Ctl_ATDeePC_idx_yterm_I = Simulink.Bus()
  b: double
  e: double
  sz: double
  r: double

otter_vel_DeePC_DeePC_Ctl_ATDeePC_idx_uterm_I = Simulink.Bus()
  b: double
  e: double
  sz: double
  r: double

otter_vel_DeePC_DeePC_Ctl_ATDeePC_idx_uterm_v_I = Simulink.Bus()
  b: double
  e: double
  sz: double
  r: double

otter_vel_DeePC_DeePC_Ctl_ATDeePC_idx_yterm_v_I = Simulink.Bus()
  b: double
  e: double
  sz: double
  r: double

otter_vel_DeePC_DeePC_Ctl_ATDeePC_idx_affine_v_I = Simulink.Bus()
  b: double
  e: double
  sz: double
  r: double

otter_vel_DeePC_DeePC_Ctl_ATDeePC_idx_term_v_I = Simulink.Bus()
  b: double
  e: double
  sz: double
  r: double[1 3]

otter_vel_DeePC_DeePC_Ctl_ATDeePC_idx_a_I = Simulink.Bus()
  b: double
  e: double
  sz: double
  r: double[1 53]

otter_vel_DeePC_DeePC_Ctl_ATDeePC_idx_yp_v_I = Simulink.Bus()
  b: double
  e: double
  sz: double
  r: double

otter_vel_DeePC_DeePC_Ctl_ATDeePC_idx_state_I = Simulink.Bus()
  b: double
  e: double
  sz: double
  r: double[1 134]

otter_vel_DeePC_DeePC_Ctl_ATDeePC_idx_u_lt_I = Simulink.Bus()
  b: double
  e: double
  sz: double
  r: double[1 50]

otter_vel_DeePC_DeePC_Ctl_ATDeePC_idx_y_lt_I = Simulink.Bus()
  b: double
  e: double
  sz: double
  r: double[1 25]

otter_vel_DeePC_DeePC_Ctl_ATDeePC_idx_DT = Simulink.Bus()
  m: double
  p: double
  uini_v: otter_vel_DeePC_DeePC_Ctl_ATDeePC_idx_uini_v_I
  u_v: otter_vel_DeePC_DeePC_Ctl_ATDeePC_idx_u_v_I
  yini_v: otter_vel_DeePC_DeePC_Ctl_ATDeePC_idx_yini_v_I
  y_v: otter_vel_DeePC_DeePC_Ctl_ATDeePC_idx_y_v_I
  u: otter_vel_DeePC_DeePC_Ctl_ATDeePC_idx_u_I
  y: otter_vel_DeePC_DeePC_Ctl_ATDeePC_idx_y_I
  yp: otter_vel_DeePC_DeePC_Ctl_ATDeePC_idx_yp_I
  s: otter_vel_DeePC_DeePC_Ctl_ATDeePC_idx_s_I
  A_v: otter_vel_DeePC_DeePC_Ctl_ATDeePC_idx_A_v_I
  yterm: otter_vel_DeePC_DeePC_Ctl_ATDeePC_idx_yterm_I
  uterm: otter_vel_DeePC_DeePC_Ctl_ATDeePC_idx_uterm_I
  uterm_v: otter_vel_DeePC_DeePC_Ctl_ATDeePC_idx_uterm_v_I
  yterm_v: otter_vel_DeePC_DeePC_Ctl_ATDeePC_idx_yterm_v_I
  affine_v: otter_vel_DeePC_DeePC_Ctl_ATDeePC_idx_affine_v_I
  total_constraints: double
  term_v: otter_vel_DeePC_DeePC_Ctl_ATDeePC_idx_term_v_I
  a: otter_vel_DeePC_DeePC_Ctl_ATDeePC_idx_a_I
  yp_v: otter_vel_DeePC_DeePC_Ctl_ATDeePC_idx_yp_v_I
  state: otter_vel_DeePC_DeePC_Ctl_ATDeePC_idx_state_I
  u_lt: otter_vel_DeePC_DeePC_Ctl_ATDeePC_idx_u_lt_I
  y_lt: otter_vel_DeePC_DeePC_Ctl_ATDeePC_idx_y_lt_I

otter_vel_DeePC_DeePC_Ctl_ATDeePC_DT = Simulink.Bus()
  Ts: double
  T: double
  m: double
  p: double
  L: double
  n: double
  Tini: double
  vel_stop_idx: double
  idx: otter_vel_DeePC_DeePC_Ctl_ATDeePC_idx_DT
  x_op_u: double[25 1]
  x_op_y: double[25 1]
  x_op_g: double[53 1]
  uini: double[3 1]
  yini: double[3 1]
  A: double[59 134]
  b: double[59 1]
  A_lt: double[75 134]
  b_lt: double[75 1]
  optim_T: double[134 134]
  optim_f: double[134 1]
  x_op: double[134 1]
  lb: double[134 1]
  ub: double[134 1]
  fval: double
  has_lt: double
  db_x_op: double[15 134]
  db_fval_op: double[15 1]
  db_active_idx: double

otter_vel_DeePC_DeePC_Ctl_ATDeePC_PT = Simulink.Bus()
  L: double
  Tini: double
  Ts: double
  pos_control: double
  n: double
  D_u: double[80 1]
  D_y: double[80 1]
  end_point: double
  T: double
  R: double
  Q: double
  lambda_a: double
  lambda_s: double
  lambda_s_ini: double
  lambda_term_u: double
  lambda_term_y: double
  Lc: double
  terminal_constraint_size: double
  affine_constraint: double
  use_overshoot_constraints: double
  use_input_terminal_constraints: double
  use_input_delta_constraints: double
  is_strict_terminal_constraint: double
  k: double
  input_delta: double
  decay: double
  delta_sat: double
  allowed_offset_terminal: double
  allowed_offset_slack: double
  u_min: double
  u_max: double
  y_min: double
  y_max: double
  dataset_bank_size: double

otter_vel_DeePC_DeePC_Ctl_ATDeePC_LT = Simulink.Bus()
  x_op_u: double[25 1]
  x_op_y: double[25 1]
  x_op_g: double[53 1]

otter_vel_DeePC_DeePC_Ctl_ATDeePC_trajectory_T = Simulink.Bus()
  D_u: double[80 1]
  D_y: double[80 1]
  end_point: double

otter_vel_EKF_LT = Simulink.Bus()

otter_vel_Gauss_PT = Simulink.Bus()
  mu: double
  sigma: double

otter_vel_Gauss_LT = Simulink.Bus()

otter_vel_Gauss_noise_PT = Simulink.Bus()
  mu: double
  sigma: double

otter_vel_Gauss_noise_LT = Simulink.Bus()

otter_vel_Gauss_noise1_PT = Simulink.Bus()
  mu: double
  sigma: double

otter_vel_Gauss_noise1_LT = Simulink.Bus()

otter_vel_Gauss_noise2_PT = Simulink.Bus()
  mu: double
  sigma: double

otter_vel_Gauss_noise2_LT = Simulink.Bus()