% Simulink data dictionary quadcopter_bus_types.sldd

quadcopter_LinearSystem_DT = Simulink.Bus()
  D: double[9 4]

quadcopter_LinearSystem_PT = Simulink.Bus()
  A: double[9 9]
  B: double[9 4]
  C: double[9 9]
  D: double
  sat_min: double
  sat_max: double

quadcopter_LinearSystem_LT = Simulink.Bus()
quadcopter_PropagateState_LT = Simulink.Bus()
quadcopter_ZeroNoise_LT = Simulink.Bus()
quadcopter_ZeroNoise_sys_LT = Simulink.Bus()