% Simulink data dictionary small_differential_bus_types.sldd

small_differential_DeePC_DeePC_idx_uini_v_I = Simulink.Bus()
  b: double
  e: double
  sz: double
  r: double[1 3]

small_differential_DeePC_DeePC_idx_u_v_I = Simulink.Bus()
  b: double
  e: double
  sz: double
  r: double[1 25]

small_differential_DeePC_DeePC_idx_yini_v_I = Simulink.Bus()
  b: double
  e: double
  sz: double
  r: double[1 3]

small_differential_DeePC_DeePC_idx_y_v_I = Simulink.Bus()
  b: double
  e: double
  sz: double
  r: double[1 25]

small_differential_DeePC_DeePC_idx_u_I = Simulink.Bus()
  b: double
  e: double
  sz: double
  r: double[1 25]

small_differential_DeePC_DeePC_idx_y_I = Simulink.Bus()
  b: double
  e: double
  sz: double
  r: double[1 25]

small_differential_DeePC_DeePC_idx_yp_I = Simulink.Bus()
  b: double
  e: double
  sz: double
  r: double

small_differential_DeePC_DeePC_idx_s_I = Simulink.Bus()
  b: double
  e: double
  sz: double
  r: double[1 28]

small_differential_DeePC_DeePC_idx_A_v_I = Simulink.Bus()
  b: double
  e: double
  sz: double
  r: double[1 56]

small_differential_DeePC_DeePC_idx_yterm_I = Simulink.Bus()
  b: double
  e: double
  sz: double
  r: double

small_differential_DeePC_DeePC_idx_uterm_I = Simulink.Bus()
  b: double
  e: double
  sz: double
  r: double

small_differential_DeePC_DeePC_idx_uterm_v_I = Simulink.Bus()
  b: double
  e: double
  sz: double
  r: double

small_differential_DeePC_DeePC_idx_yterm_v_I = Simulink.Bus()
  b: double
  e: double
  sz: double
  r: double

small_differential_DeePC_DeePC_idx_affine_v_I = Simulink.Bus()
  b: double
  e: double
  sz: double
  r: double

small_differential_DeePC_DeePC_idx_term_v_I = Simulink.Bus()
  b: double
  e: double
  sz: double
  r: double[1 3]

small_differential_DeePC_DeePC_idx_a_I = Simulink.Bus()
  b: double
  e: double
  sz: double
  r: double[1 53]

small_differential_DeePC_DeePC_idx_yp_v_I = Simulink.Bus()
  b: double
  e: double
  sz: double
  r: double

small_differential_DeePC_DeePC_idx_state_I = Simulink.Bus()
  b: double
  e: double
  sz: double
  r: double[1 134]

small_differential_DeePC_DeePC_idx_u_lt_I = Simulink.Bus()
  b: double
  e: double
  sz: double
  r: double[1 50]

small_differential_DeePC_DeePC_idx_y_lt_I = Simulink.Bus()
  b: double
  e: double
  sz: double
  r: double[1 25]

small_differential_DeePC_DeePC_idx_DT = Simulink.Bus()
  m: double
  p: double
  uini_v: small_differential_DeePC_DeePC_idx_uini_v_I
  u_v: small_differential_DeePC_DeePC_idx_u_v_I
  yini_v: small_differential_DeePC_DeePC_idx_yini_v_I
  y_v: small_differential_DeePC_DeePC_idx_y_v_I
  u: small_differential_DeePC_DeePC_idx_u_I
  y: small_differential_DeePC_DeePC_idx_y_I
  yp: small_differential_DeePC_DeePC_idx_yp_I
  s: small_differential_DeePC_DeePC_idx_s_I
  A_v: small_differential_DeePC_DeePC_idx_A_v_I
  yterm: small_differential_DeePC_DeePC_idx_yterm_I
  uterm: small_differential_DeePC_DeePC_idx_uterm_I
  uterm_v: small_differential_DeePC_DeePC_idx_uterm_v_I
  yterm_v: small_differential_DeePC_DeePC_idx_yterm_v_I
  affine_v: small_differential_DeePC_DeePC_idx_affine_v_I
  total_constraints: double
  term_v: small_differential_DeePC_DeePC_idx_term_v_I
  a: small_differential_DeePC_DeePC_idx_a_I
  yp_v: small_differential_DeePC_DeePC_idx_yp_v_I
  state: small_differential_DeePC_DeePC_idx_state_I
  u_lt: small_differential_DeePC_DeePC_idx_u_lt_I
  y_lt: small_differential_DeePC_DeePC_idx_y_lt_I

small_differential_DeePC_DeePC_DT = Simulink.Bus()
  Ts: double
  T: double
  m: double
  p: double
  L: double
  n: double
  Tini: double
  vel_stop_idx: double
  idx: small_differential_DeePC_DeePC_idx_DT
  x_op_u: double[25 1]
  x_op_y: double[25 1]
  x_op_g: double[53 1]
  uini: double[3 1]
  yini: double[3 1]
  A: double[59 134]
  b: double[59 1]
  A_lt: double[75 134]
  b_lt: double[75 1]
  optim_T: double[134 134]
  optim_f: double[134 1]
  x_op: double[134 1]
  lb: double[134 1]
  ub: double[134 1]
  fval: double
  has_lt: double

small_differential_DeePC_DeePC_PT = Simulink.Bus()
  L: double
  Tini: double
  Ts: double
  pos_control: double
  n: double
  D_u: double[80 1]
  D_y: double[80 1]
  end_point: double
  T: double
  R: double
  Q: double
  lambda_a: double
  lambda_s: double
  lambda_s_ini: double
  lambda_term_u: double
  lambda_term_y: double
  Lc: double
  terminal_constraint_size: double
  affine_constraint: double
  use_overshoot_constraints: double
  use_input_terminal_constraints: double
  use_input_delta_constraints: double
  is_strict_terminal_constraint: double
  k: double
  input_delta: double
  decay: double
  delta_sat: double
  allowed_offset_terminal: double
  allowed_offset_slack: double
  u_min: double
  u_max: double
  y_min: double
  y_max: double

small_differential_DeePC_DeePC_LT = Simulink.Bus()
  x_op_u: double[25 1]
  x_op_y: double[25 1]
  x_op_g: double[53 1]

small_differential_ExplicitDeePC_ExplicitDeePC_DT = Simulink.Bus()
  m: double
  p: double
  uini: double[3 1]
  yini: double[3 1]
  O: double[3 2]
  Cl: double[3 3]
  O_pinv: double[2 3]

small_differential_ExplicitDeePC_ExplicitDeePC_PT = Simulink.Bus()
  A: double[2 2]
  B: double[2 1]
  C: double[1 2]
  D: double
  Tini: double
  is_incremental: double
  u_min: double
  u_max: double
  base_variable_name: uint8[1 12]