% Simulink data dictionary otter_types.sldd

dataset_bank_T = Simulink.Bus()
  Db_u: double[N,T]
  Db_y: double[N,T]
  end_point: double[N,1]
  num_datasets: double

Copy_1_of_dataset_bank_T = Simulink.Bus()
  Db_u: double[N,T]
  Db_y: double[N,T]
  end_point: double[N,1]
  num_datasets: double